vi "Dowload a File.gviweb"   [LabVIEW NXG 3.1.0]
inputs:
  "File Name": string = "File.csv", required
  "Download Data": string[][] = [["1", "2"], ["2", "3"], ["3", "10"]], required
  "Error In": error
outputs:
  "Data to Flattened JSON String": string
  "Error Out": error
uses:
  UploadLibrary::DownloadOrUploadFromWebVI.jsli::DownloadFileFromWebVI
diagram:
  Flatten To JSON(anything=$"Download Data", error in (no error)=$"Error In") -> (JSON string=w1, error out=w2)
  call "DownloadFileFromWebVI"(FileName=$"File Name", FileText=w1, error in=w2) -> (error out=w3)
  $"Error Out" <- w3
  $"Data to Flattened JSON String" <- w1
