vi "Upload a File.gviweb"   [LabVIEW NXG 3.1.0]
inputs:
  "Error In": error
outputs:
  "FileText": string
  "Error Out": error
panel indicators:
  "DoneReading": bool
uses:
  UploadLibrary::DownloadOrUploadFromWebVI.jsli::OpenFileWebVI
  UploadLibrary::DownloadOrUploadFromWebVI.jsli::CheckIfDone
  UploadLibrary::DownloadOrUploadFromWebVI.jsli::ReadText
diagram:
  call "OpenFileWebVI"(error in=$"Error In") -> (error out=w1)
  while {
    Wait(time to wait=10)
    call "CheckIfDone"(error in=w1) -> (DoneReadingFile?=w2, error out=w3)
    $DoneReading <- w2
    stop if w2
  }
  call "ReadText"(error in=w3) -> (FileText=w4, error out=w5)
  $FileText <- w4
  $"Error Out" <- w5
