vi "File Download or Upload.gviweb"   [LabVIEW NXG 3.1.0]
panel controls:
  "Upload": bool
  "Download": bool
  "Download Data": string[][] = [["1", "27"], ["2", "45"], ["3", "10"], ["4", "75"]]
  "File Name": string = "File.csv"
  "Error": error
panel indicators:
  "File Text": string
uses:
  UploadLibrary::subVI::Upload a File.gviweb
  UploadLibrary::subVI::Dowload a File.gviweb
diagram:
  w1 = $Error
  while {
    Wait(time to wait=10)
    case ($Upload) {
      frame False, Default {
        w2 = w1
      }
      frame True {
        call "Upload a File.gviweb"(Error In=w1) -> (FileText=w3, Error Out=w2)
        $"File Text" <- w3
      }
    }
    case ($Download) {
      frame False, Default {
        w4 = w1
      }
      frame True {
        call "Dowload a File.gviweb"(File Name=$"File Name", Download Data=$"Download Data", Error In=w1) -> (Error Out=w4)
      }
    }
    Merge Errors(w2, w4) -> (error out=w5)
    stop if w5
  }
